# Grasshopper definition assignment3.gh (Grasshopper 0.9.76)
# Copyright: All rights reserved
# plug-ins: Python Interpreter

# ----
# Point Cloud (PC) input
id = Guid(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)
# Input
c_script = CSharpScript(
    id=id,
    Reference="C:\Users\Balázs\Documents\GEO1004_3D\MathNet.Numerics-3.4.0\MathNet.Numerics\Net40\MathNet.Numerics.dll")  # -> out, P, N, C; inputs id: Guid
# ---------- c_script: C# ----------
    object obj = RhinoDocument.Objects.Find(id);
    if (obj == null)
      return;

    Rhino.DocObjects.PointCloudObject cloudObject = obj as Rhino.DocObjects.PointCloudObject;
    if (cloudObject == null)
      return;
    PointCloud cloud = cloudObject.PointCloudGeometry;

    List<Point3d> points = new List<Point3d>();
    List<Vector3d> normals = null;
    List<Color> colours = null;

    if (cloud.ContainsNormals)
      normals = new List<Vector3d>();
    if (cloud.ContainsColors)
      colours = new List<Color>();

    foreach (PointCloudItem item in cloud)
    {
      points.Add(item.Location);

      if (normals != null)
        normals.Add(item.Normal);
      if (colours != null)
        colours.Add(item.Color);
    }

    P = points;
    N = normals;
    C = colours;
# ---------- end c_script ----------

# ----
# Subset the points in the PC for quick calculations in tests.
nr_of_points = Slider(200, range=0..4000)
filtering = BooleanToggle(True)
subset_points = PythonScript(x=c_script.P, range=nr_of_points, switch=filtering)  # -> out, a; inputs x: list, range: Int32
# ---------- subset_points: Python ----------
if switch:
    a = x[0:range]
else:
    a = x
print x[0]
# ---------- end subset_points ----------

curvature_threshold = Slider(0.25, range=0..1)
angle_threshold = Slider(0.25, range=0..1)
knn = BooleanToggle(False)

# ----
# Normal and curvature
# estimates
number_slider = Slider(13, range=1..20)
R = Slider(0.45, range=0..5)
knn_2 = PythonScript(PC=subset_points.a, k=number_slider)  # -> out, a, N, Cur; inputs PC: list of Point3d, k: Int32
# ---------- knn_2: Python ----------
"""
Reference: http://machinelearningmastery.com/tutorial-to-implement-k-nearest-neighbors-in-python-from-scratch/
"""
import clr
clr.AddReference("mtrand")

import math
import operator 
import numpy as np
from numpy import linalg as LA
import Rhino.Geometry as RG

def getNeighbors(PC, point, k):
    """
    Calculates the k-Nearest Neighbours(k) for each point(point) in a point cloud(PC)
    Input: 
        PC: Point Cloud as list of points (Point3d )
        point: a single reference point (Point3d)
        k: number of points in the neihborhood
    Output:
        list: [reference point, pt_1, pt_2, ..., pt_k]
    """
    distances = []
    for pt in range(len(PC)):
        dist = point.DistanceTo(PC[pt])
        distances.append((PC[pt], dist, pt))
    # sort the distances in ascending order
    distances.sort(key=operator.itemgetter(1)) 
    neighbors = []
    for x in range(k):
        # retrieve the shortest distance
        neighbors.append((distances[x][0], distances[x][2]))
    return neighbors

# create a list of lists of points+neihborhoods as [[point_n, neighbors],[],...]   
kNN_list = [[] for x in xrange(len(PC))] 
for point in range(len(PC)):
    # first element in the sublist is the reference point in the neihborhood
    #kNN_list[point].append((PC[point],point))
    neighbors = getNeighbors(PC, PC[point], k)
    # the following elements are the neighbors
    [kNN_list[point].append(i) for i in neighbors]
    
a = kNN_list
#print kNN_list[0]

#=======================
# Estimation of normals
#=======================
covM = [] # the list of covariance matrices
#point_a = np.empty([len(kNN_list[0]),3]) # a single empty array shaped as an input for the covariance matrix

for Pgroup in range(len(kNN_list)):
    point_a = np.empty([len(kNN_list[Pgroup]),3])
    for point in range(len(kNN_list[Pgroup])):
        #print kNN_list[Pgroup][point]
        point_a[point][0] = kNN_list[Pgroup][point][0][0] # X
        point_a[point][1] = kNN_list[Pgroup][point][0][1] # Y
        point_a[point][2] = kNN_list[Pgroup][point][0][2] # Z
    m = np.cov(point_a, rowvar=0) #each column represents a variable, while the rows contain observations
    covM.append(m)

normals = []
eigenValues = []
index = 0
for m in range(len(kNN_list)):
   # calculate eigenvalues (e_vals) and eigenvectors (e_vecs)
   e_vals, e_vecs = LA.eig(covM[m])
   eigenValues.append(e_vals)
   # get the smallest eigenvalue
   eMin = np.argmin(e_vals)
   # retrieve the smallest eigenvector corresponding to the smallest eigenvalue
   normal = e_vecs[eMin]
   # cast normal coordinates into floats
   normal = [float(i) for i in normal]
   # create a Vector3d from each normal
   normals.append([kNN_list[m],RG.Vector3d(normal[0],normal[1],normal[2])])


#=======================
# Check if the direction of the normals are in align with the point of origin of the LIDAR laser beam
Z = RG.Vector3d(0,0,1)
normals_copy = normals[:]
for i in range(len(normals_copy)):
    v = normals_copy[i][1]
    # unitize normals
    v.Unitize()
    # compute dot product of Z unit vector and normal
    dp = RG.Vector3d.Multiply(Z,v) 
    if dp < 0.0:
        # if dot product negative, reverse vector
        normals[i][1].Reverse()


#=======================
# Estimation of surface curvature
#=======================
#curvature = []
for n in range(len(normals)):
    v = normals[n][1]
    c = v[0]/(v[0]+v[1]+v[2])
    normals[n].append(c)
#Cur = curvature[0]

#print normals[0]

N = normals
# ---------- end knn_2 ----------
fdn = PythonScript(PC=subset_points.a, R=R)  # -> out, a, N, Cur; inputs PC: list of Point3d; disabled
# ---------- fdn: Python ----------
"""  
Just some alternative ideas...
 
for pt in range(len(PC)): 
    RG.Circle(pt, R)
    RG.Curve.Contains(testPoint)
        
create circle with pt as center and R as radius
which points fall into this circle
center point should not be duplicated
"""

import clr
clr.AddReference("mtrand")

import math
import operator 
import numpy as np
from numpy import linalg as LA
import Rhino.Geometry as RG

#=========
# Create Fixed Distance Neighbourhoods
#=========

def getNeighboursInRange(PC, R):
    """
    Get the neighbours in range R
    Input:
        PC: point cloud as list of points (Point3d)
        R: the range/radius (float)
    Output:
        list: list: [reference point, pt_1, pt_2, ..., pt_k]
    """
    # create a list of lists of points+neihborhoods as [[point_n, neighbors],[],...]
    FDN_list = [[] for x in xrange(len(PC))]
    for pt in range(len(PC)):
        p = PC[pt]
        # first element in the sublist is the reference point in the neihborhood
        FDN_list[pt].append(PC[pt])
        neighbours = []
        for p2 in range(len(PC)):
            # calculate distance for each point in PC
            if p.DistanceTo(PC[p2]) < R:
                neighbours.append(PC[p2])
        # the following elements are the neighbors
        [FDN_list[pt].append(i) for i in neighbours]
    return FDN_list
   

FDN_list = getNeighboursInRange(PC,R)
a = FDN_list

#=======================
# Estimation of normals
#=======================
covM = [] # the list of covariance matrices

for Pgroup in range(len(FDN_list)):
    if len(FDN_list[Pgroup]) <= 1:
        continue
    else:
        point_a = np.empty([len(FDN_list[Pgroup]),3])
        for point in range(len(FDN_list[Pgroup])):
            point_a[point][0] = FDN_list[Pgroup][point][0] # X
            point_a[point][1] = FDN_list[Pgroup][point][1] # Y
            point_a[point][2] = FDN_list[Pgroup][point][2] # Z
        m = np.cov(point_a, rowvar=0)
        if np.isnan(np.sum(m)) or np.isinf(np.sum(m)):
            continue
        else:
            #each column represents a variable, while the rows contain observations
            covM.append(m)

normals = []
for m in range(len(FDN_list)):
   # calculate eigenvalues (e_vals) and eigenvectors (e_vecs)
   e_vals, e_vecs = LA.eig(covM[m])
   # get the smallest eigenvalue
   eMin = np.argmin(e_vals)
   # retrieve the smallest eigenvector corresponding to the smallest eigenvalue
   normal = e_vecs[eMin]
   # cast normal coordinates into floats
   normal = [float(i) for i in normal]
   # create a Vector3d from each normal
   # include the respective point for segmentation calculations
   x = FDN_list[m][0][0]
   y = FDN_list[m][0][1]
   z = FDN_list[m][0][2]
   normals.append([RG.Point3d(x,y,z),RG.Vector3d(normal[0],normal[1],normal[2])]) 
#N = normals

#=======================
# Check if the direction of the normals are in align with the point of origin of the LIDAR laser beam
Z = RG.Vector3d(0,0,1)
normals_copy = normals[:]
for i in range(len(normals_copy)):
    v = normals_copy[i][1]
    # unitize normals
    v.Unitize()
    # compute dot product of Z unit vector and normal
    dp = RG.Vector3d.Multiply(Z,v) 
    if dp < 0.0:
        # if dot product negative, reverse vector
        normals[i][1].Reverse() 

#=======================
# Estimation of surface curvature
#=======================
curvature = []
for n in normals:
    v = n[1]
    c = v[0]/(v[0]+v[1]+v[2])
    curvature.append([n[0],c])
Cur = curvature
# ---------- end fdn ----------

region_growing = PythonScript(PC=subset_points.a, N=fdn.N, c=fdn.a, cTh=curvature_threshold, aTh=angle_threshold, n_function=knn)  # -> out, a
# ---------- region_growing: Python ----------
# PC - point cloud
# N - normals
# cTh - curvature threshold
# aTh - angle threshold
# c - curvature estimates

# ==================
# FDN 
# ==================
def getNeighboursInRange(PC, R):
    """
    Get the neighbours in range R
    Input:
        PC: point cloud as list of points (Point3d)
        R: the range/radius (float)
    Output:
        list: list: [reference point, pt_1, pt_2, ..., pt_k]
    """
    # create a list of lists of points+neihborhoods as [[point_n, neighbors],[],...]
    FDN_list = [[] for x in xrange(len(PC))]
    for pt in range(len(PC)):
        p = PC[pt]
        # first element in the sublist is the reference point in the neihborhood
        FDN_list[pt].append(PC[pt])
        neighbours = []
        for p2 in range(len(PC)):
            # calculate distance for each point in PC
            if p.DistanceTo(PC[p2]) < R:
                neighbours.append(PC[p2])
        # the following elements are the neighbors
        [FDN_list[pt].append(i) for i in neighbours]
    return FDN_list
    
# ==================
# kNN
# ==================
def getNeighbors(PC, point, k):
    """
    Calculates the k-Nearest Neighbours(k) for each point(point) in a point cloud(PC)
    Input: 
        PC: Point Cloud as list of points (Point3d )
        point: a single reference point (Point3d)
        k: number of points in the neihborhood
    Output:
        list: [reference point, pt_1, pt_2, ..., pt_k]
    """
    distances = []
    for pt in range(len(PC)):
        dist = point.DistanceTo(PC[pt])
        distances.append((PC[pt], dist))
    # sort the distances in ascending order
    distances.sort(key=operator.itemgetter(1)) 
    neighbors = []
    for x in range(k):
        # retrieve the shortest distance
        neighbors.append(distances[x][0])
        
    # create a list of lists of points+neihborhoods as [[point_n, neighbors],[],...]   
    kNN_list = [[] for x in xrange(len(PC))] 
    for point in range(len(PC)):
        # first element in the sublist is the reference point in the neihborhood
        kNN_list[point].append(PC[point])
        neighbors = getNeighbors(PC, PC[point], k)
        # the following elements are the neighbors
        [kNN_list[point].append(i) for i in neighbors]
        
    return kNN_list
    
print c
# ---------- end region_growing ----------

# ----
# Visualization
curvature = Number(fdn.Cur)
N = Numbers(curvature)
bnd = Bounds(Numbers=N)
de = DeconstructDomain(Domain=bnd)  # -> Start, End
gradient = Gradient(LowerLimit=de.Start, UpperLimit=de.End, Parameter=N, stops=[0: RGB(0, 128, 0), 0.5: RGB(255, 255, 0), 1: RGB(255, 0, 0)])
curvature_2 = CustomPreview(Geometry=subset_points.a, Shader=gradient)

# ---- group: Visualize point neighborhoods
point_nr = Slider(105, range=0..1000)
point_size = Slider(0.03, range=0..0.1)
i = Integer(point_nr)
python = PythonScript(x=fdn.N, i=i)  # -> out, A; inputs x: list
# ---------- python: Python ----------
points = x[i]
A = points
# ---------- end python ----------
item = ListItem(List=subset_points.a, Index=i, Wrap=True)
dots = DotDisplay(Point=python.A, Colour=RGB(0, 0, 0), Size=point_size)
ln = Line(StartPoint=item, EndPoint=python.A)
dots_2 = DotDisplay(Point=item, Colour=RGB(255, 110, 110), Size=point_size)

# ---- group: Visualize normals
short = ShortestList(ListA=subset_points.a, ListB=fdn.N, TrimMode=2)  # -> ListA, ListB
vdis = VectorDisplay(Anchor=short.ListA, Vector=short.ListB)
